% Simulink data dictionary ModelDictionary.sldd

Sig = Simulink.Signal()

actualAngles = Simulink.Bus()
  actualAngle_LHFE: double
  actualAngle_LKFE: double
  actualAngle_RHFE: double
  actualAngle_RKFE: double

actualDynamics = Simulink.Bus()
  actualAngles: Bus: actualAngles
  actualVelocities: Bus: actualVelocities
  actualTorques: Bus: actualTorques

actualTorques = Simulink.Bus()
  actualTorque_LHFE: double
  actualTorque_LKFE: double
  actualTorque_RHFE: double
  actualTorque_RKFE: double

actualVelocities = Simulink.Bus()
  actualVelocity_LHFE: double
  actualVelocity_LKFE: double
  actualVelocity_RHFE: double
  actualVelocity_RKFE: double

calculatedAngles = Simulink.Bus()
  calculatedAngle_LHFE: double
  calculatedAngle_LKFE: double
  calculatedAngle_RHFE: double
  calculatedAngle_RKFE: double

calculatedDynamics = Simulink.Bus()
  calculatedAngles: Bus: calculatedAngles
  calculatedVelocities: Bus: calculatedVelocities
  calculatedTorques: Bus: calculatedTorques

calculatedTorques = Simulink.Bus()
  calculatedTorque_LHFE: double
  calculatedTorque_LKFE: double
  calculatedTorque_RHFE: double
  calculatedTorque_RKFE: double

calculatedVelocities = Simulink.Bus()
  calculatedVelocity_LHFE: double
  calculatedVelocity_LKFE: double
  calculatedVelocity_RHFE: double
  calculatedVelocity_RKFE: double

targetAngles = Simulink.Bus()
  targetAngle_LHFE: double
  targetAngle_LKFE: double
  targetAngle_RHFE: double
  targetAngle_RKFE: double

targetTorques = Simulink.Bus()
  targetTorque_LHFE: double
  targetTorque_LKFE: double
  targetTorque_RHFE: double
  targetTorque_RKFE: double

targetVelocities = Simulink.Bus()
  targetVelocity_LHFE: double
  targetVelocity_LKFE: double
  targetVelocity_RHFE: double
  targetVelocity_RKFE: double

maxTorques = Simulink.Bus()
  maxTorque_LHFE: double
  maxTorque_LKFE: double
  maxTorque_RHFE: double
  maxTorque_RKFE: double

inDataSOMANETs = Simulink.Bus()
  inSOMANET_LHFE: Bus: inSOMANET
  inSOMANET_LKFE: Bus: inSOMANET
  inSOMANET_RHFE: Bus: inSOMANET
  inSOMANET_RKFE: Bus: inSOMANET

toDataSOMANETs = Simulink.Bus()
  toSOMANET_LHFE: Bus: toSOMANET
  toSOMANET_LKFE: Bus: toSOMANET
  toSOMANET_RHFE: Bus: toSOMANET
  toSOMANET_RKFE: Bus: toSOMANET

targetDynamics = Simulink.Bus()
  targetDynamica_LHFE: Bus: targetDynamica
  targetDynamica_LKFE: Bus: targetDynamica
  targetDynamica_RHFE: Bus: targetDynamica
  targetDynamica_RKFE: Bus: targetDynamica

toPowerElectronics = Simulink.Bus()
  toPDB: Bus: toPDB

toGES = Simulink.Bus()
  a: double

inPowerElectronics = Simulink.Bus()
  statusPDB: Bus: statusPDB
  statusBMS: Bus: statusBMS

statusBMS = Simulink.Bus()
  stateBMS: double
  statusChargeBattery: double
  statusTemperatureBattery: double
  minVoltCell: double
  maxVoltCell: double

inGES = Simulink.Bus()
  statusTemperatureMotor_LHFE: double
  statusTemperatureMotor_LKFE: double
  statusTemperatureMotor_RHFE: double
  statusTemperatureMotor_RKFE: double

statusPhaseCurrents = Simulink.Bus()
  statusPhaseCurrentBC_LHFE: Bus: statusPhaseCurrentBC
  statusPhaseCurrentBC_LKFE: Bus: statusPhaseCurrentBC
  statusPhaseCurrentBC_RHFE: Bus: statusPhaseCurrentBC
  statusPhaseCurrentBC_RKFE: Bus: statusPhaseCurrentBC

inInputDevice = Simulink.Bus()
  desiredState: double
  error: double

configSOMANET = Simulink.Bus()
  angleOffset: double
  polePairs: double
  minPosLimit: double
  maxPosLimit: double
  maxSpeed: double
  maxTorque: double
  positionKp: double
  positionKi: double
  positionKd: double
  positionIntegralLimit: double
  velocityKp: double
  velocityKi: double
  velocityKd: double
  velocityIntegralLimit: double
  breakReleaseStrategy: double

configSOMANETs = Simulink.Bus()
  configSOMANET_LHFE: Bus: configSOMANET
  configSOMANET_LKFE: Bus: configSOMANET
  configSOMANET_RHFE: Bus: configSOMANET
  configSOMANET_RKFE: Bus: configSOMANET

data = Simulink.Bus()
  inDataSOMANETs: Bus: inDataSOMANETs
  inInputDevice: Bus: inInputDevice
  inGES: Bus: inGES
  inPowerElectronics: Bus: inPowerElectronics
  toDataSOMANETs: Bus: toDataSOMANETs
  toInputDevice: Bus: toInputDevice
  toPowerElectronics: Bus: toPowerElectronics
  toGES: Bus: toGES
  error: Bus: error
  gaitPhase: double
  actualStateMARCH: double
  configSOMANETs: Bus: configSOMANETs
  calculatedDynamics: Bus: calculatedDynamics

error = Simulink.Bus()
  errorSOMANETs: Bus: errorSOMANETs
  errorInputDevice: double
  errorGES: Bus: errorGES
  errorPowerElectronics: Bus: errorPowerElectronics

errorGES = Simulink.Bus()
  errorGES1: double
  errorGES2: double

errorPowerElectronics = Simulink.Bus()
  errorPDB: double
  errorBMS: double

statusPDB = Simulink.Bus()
  statePDB: double
  statusCurrentBattery: double
  statusVoltageBattery: double
  statusTemperatureDCDC: double

toInputDevice = Simulink.Bus()
  actualStateMARCH: double
  error: double

toPDB = Simulink.Bus()
  masterOP: double

maxAngle = 6.283185
maxNonResponsive = 0.3
maxPhaseCurrent = 0.2
maxTemperature = 120
maxTorque = 2
maxVelocity = 5

testVector = Simulink.Bus()
  statusword: double
  controlword: double
  desiredOpMode: double
  errorSOMANET: double
  state: Enum: State
  quickstop: double

actualDynamica = Simulink.Bus()
  actualAngle: double
  actualVelocity: double
  actualTorque: double

errorSOMANETs = Simulink.Bus()
  errorSOMANET_LHFE: double
  errorSOMANET_LKFE: double
  errorSOMANET_RHFE: double
  errorSOMANET_RKFE: double

inSOMANET = Simulink.Bus()
  statusword: double
  actualAngle: double
  actualVelocity: double
  actualTorque: double
  userMISO: double
  tuningStatus: double
  errorSOMANET: double
  statusPhaseCurrentB: double
  statusPhaseCurrentC: double
  opMode: double
  statusTemperature: double
  timestamp: double

statusPhaseCurrentBC = Simulink.Bus()
  statusPhaseCurrentB: double
  statusPhaseCurrentC: double

targetDynamica = Simulink.Bus()
  targetAngle: double
  targetVelocity: double
  targetTorque: double

toSOMANET = Simulink.Bus()
  controlword: double
  opMode: double
  targetAngle: double
  targetVelocity: double
  targetTorque: double
  tuningCommand: double
  userMOSI: double
  maxTorque: double

angleHip = [0.1886164; 0.188616; 0.188615; 0.1886133; 0.1886109; 0.1886079; 0.1886041; 0.1885997; 0.1885946; 0.1885889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 0.1886382]
angleKnee = [0; 2.6865e-06; 1.073272e-05; 2.411876e-05; 4.28247e-05; 6.683063e-05; 9.611665e-05; 0.0001306628; 0.0001704493; 0.000215456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 6.471225e-05]